# Grasshopper definition Grasshopper-TwistedTower.gh (Grasshopper 1.0.7)

number_slider = Slider(24, range=0..100)
number_slider_2 = Slider(100, range=0..100)
series = Series(Start=Slider(0, range=0..100), Step=Slider(5, range=1..5), Count=number_slider)
unit_z = UnitZ(Factor=series)
rectangle = Rectangle(Plane=PlaneXY(0, 0, 0), XSize=number_slider_2, YSize=number_slider_2, Radius=0)  # -> Rectangle, Length
series_2 = Series(Start=Slider(0, range=0..10), Step=Slider(7, range=0..10), Count=number_slider)
move = Move(Geometry=rectangle.Rectangle, Motion=unit_z)  # -> Geometry, Transform
area = Area(Geometry=rectangle.Rectangle)  # -> Area, Centroid
rotate = Rotate(Geometry=move.Geometry, Angle=degrees(series_2), Plane=area.Centroid)  # -> Geometry, Transform
series_3 = Series(Start=Slider(0.173, range=0..1), Step=Slider(0.006, range=0..1), Count=number_slider)
polygon_center = PolygonCenter(Polyline=rotate.Geometry)  # -> CenterV, CenterE, CenterA
scale = Scale(Geometry=rotate.Geometry, Center=polygon_center.CenterE, Factor=reverse(series_3))  # -> Geometry, Transform
loft = Loft(Curves=scale.Geometry, Options={Adjust=False, Closed=False, LoftEnds=0, LoftSimp=0, LoftType=0, Rebuild=10, Refit=0.01})
geometry = Geometry(loft)
panel = Panel(scale.Geometry)
